# Grasshopper definition Getting OSM Data.gh (Grasshopper 1.0.7)
# plug-ins: ElkGHComponents

path = FilePath("C:\Users\jwheeler\Documents\GitHub\aechackathon2019\Grasshopper\Testing Elk\map (1).osm")
path_2 = FilePath("C:\Users\jwheeler\Documents\GitHub\aechackathon2019\Grasshopper\Testing Elk\map.osm")
loc = Location(FilePathText=path)  # -> OSMPointData, OSMFile, LongitudeDomain, LatitudeDomain
topo = Topography()  # -> FileInfo, Points, Curves, Surface
osm = OSMData(
    OSMPointData=loc.OSMPointData,
    OSMFilePath=loc.OSMFile,
    Feature="highway",
    Generate3d=False,
    IndividualOutputs=False,
    SelectedTypes="footway")  # -> Ways, FeatureKey

# ----
# Water
osm_2 = OSMData(
    OSMPointData=loc.OSMPointData,
    OSMFilePath=loc.OSMFile,
    Feature="natural",
    Generate3d=False,
    IndividualOutputs=False,
    SelectedTypes="water")  # -> Ways, FeatureKey
tmatch = MatchText(Text=osm_2.FeatureKey, RegEx="water", Case=True)
ma = MassAddition(Input=tmatch)  # -> Result, PartialResults
cull = CullPattern(List=osm_2.Ways, CullPattern=ma.Result)

# ----
# Grass
osm_3 = OSMData(
    OSMPointData=loc.OSMPointData,
    OSMFilePath=loc.OSMFile,
    Feature="landuse",
    Generate3d=False,
    IndividualOutputs=False,
    SelectedTypes="grass")  # -> Ways, FeatureKey

# ----
# Tree Radius
# Tree Height
panel = Panel("3000")

# ----
# Trees
osm_4 = OSMData(
    OSMPointData=loc.OSMPointData,
    OSMFilePath=loc.OSMFile,
    Feature="natural",
    Generate3d=False,
    IndividualOutputs=False,
    SelectedTypes=["tree", "tree_row"])  # -> Ways, FeatureKey
Z = UnitZ(Factor=panel)
cir = Circle(Plane=osm_4.Ways, Radius="3000")
extr = Extrude(Base=cir, Direction=Z)

panel_2 = Panel(osm.FeatureKey)

# ----
# Bake
pline = PolyLine(Vertices=osm_3.Ways, Closed=False)

# ----
# Bake
pline_2 = PolyLine(Vertices=cull, Closed=False)

# ----
# Bake
cap = CapHoles(Brep=extr)

boundary = BoundarySurfaces(Edges=pline)

# ----
# Height Per Level
panel_3 = Panel("3000")

# ----
# Building Height by Level
osm_5 = OSMData(OSMPointData=loc.OSMPointData, OSMFilePath=loc.OSMFile, Feature="building", Generate3d=False, IndividualOutputs=False)  # -> Ways, FeatureKey
tmatch_2 = MatchText(Text=osm_5.FeatureKey, RegEx="levels", Case=True)
pline_3 = PolyLine(Vertices=osm_5.Ways, Closed=True)
path_mapper = PathMapper(pline_3, source="{A;B}", target="{A}")
ma_2 = MassAddition(Input=tmatch_2)  # -> Result, PartialResults
cull_2 = CullPattern(List=osm_5.FeatureKey, CullPattern=tmatch_2)
split = TextSplit(Text=cull_2, Separators=":")  # -> reverse(Result)
item = ListItem(List=split, Index=0, Wrap=True)
multiplication = Multiplication(A=item, B=panel_3)
dispatch = Dispatch(List=path_mapper, DispatchPattern=ma_2.Result)  # -> ListA, ListB
Z_2 = UnitZ(Factor=multiplication)
Z_3 = UnitZ(Factor=panel_3)
extr_2 = Extrude(Base=dispatch.ListA, Direction=Z_2)  # -> simplify(Extrusion)

# ----
# No Level Data
extr_3 = Extrude(Base=dispatch.ListB, Direction=Z_3)  # -> simplify(Extrusion)
crv = Curve(dispatch.ListB)

# ----
# Bake
cap_2 = CapHoles(Brep=[extr_2, extr_3])

group = Group(Objects=[cap_2, cap, pline_2, boundary])
locationfinder = Ladybug_LocationFinder()  # -> readMe, location; plug-in component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
path_3 = FilePath("C:\Users\jwheeler\Documents\GitHub\aechackathon2019\Grasshopper\USA_WA_Seattle-King.County.Intl.AP-Boeing.Field.727935_TMY3\USA_WA_Seattle-King.County.Intl.AP-Boeing.Field.727935_TMY3.epw")
importepw = Ladybug_ImportEpw(epwFile=path_3)  # -> readMe, latitude, location, dryBulbTemperature, dewPointTemperature, relativeHumidity, windSpeed, windDirection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; plug-in component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
item_2 = ListItem(List=flatten(cap_2), Index=0, Wrap=True)
mesh = MeshBrep(
    Brep=item_2,
    Settings={GridMaxCount=0, GridMinCount=16, JaggedSeams=False, MaxEdgeLength=0, MinEdgeLength=0.0001, MinTolerance=0, Refine=True, RefineAngle=0, RelativeTolerance=0.65, SimplePlanes=True, Tolerance=0})
ladybug = Ladybug_Ladybug()  # -> Vviiiiiiiiiizzz; plug-in component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
srf = Surface(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)
area = Area(Geometry=item_2)  # -> Area, Centroid
day = Panel("30")
month = Panel("3")
hour = Panel("14")
mesh_2 = MeshBrep(
    Brep=flatten(cap_2),
    Settings={GridMaxCount=0, GridMinCount=16, JaggedSeams=False, MaxEdgeLength=0, MinEdgeLength=0.0001, MinTolerance=0, Refine=True, RefineAngle=0, RelativeTolerance=0.65, SimplePlanes=True, Tolerance=0})
panel_4 = Panel(importepw.location)
panel_5 = Panel(ladybug)
sunpath = Ladybug_SunPath(
    location=importepw.location,
    hour=hour,
    day=day,
    month=month,
    timeStep=1,
    centerPt=area.Centroid,
    dailyOrAnnualSunPath=True)  # -> readMe, sunVectors, sunAltitudes, sunAzimuths, port, sunSpheresMesh, sunPathCrvs, compassCrvs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; plug-in component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
mshadow = MeshShadow(Mesh=mesh_2, Light=sunpath.sunVectors, Plane=PlaneXY(0, 0, 0))
runion = RegionUnion(Curves=flatten(mshadow))
crv_2 = Curve(<curve referenced from the Rhino model>)
boundary_2 = BoundarySurfaces(Edges=runion)
Z_4 = UnitZ(Factor=1)
trim = TrimWithRegion(Curve=crv_2, Region=runion)  # -> Inside, Outside
panel_6 = Panel(trim.Outside)
ccx = CurveCurve(CurveA=runion, CurveB=crv_2)  # -> Points, ParamsA, ParamsB
extr_4 = Extrude(Base=boundary_2, Direction=Z_4)
panel_7 = Panel(ccx.ParamsB)
sunlighthoursanalysis = Ladybug_SunlightHoursAnalysis(
    geometry=flatten(srf),
    context=flatten(item_2),
    gridSize="1000",
    disFromBase="1",
    sunVectors=flatten(sunpath.sunVectors),
    timeStep=1,
    parallel=Toggle(True),
    runIt=Toggle(True))  # -> readMe, contextMesh, analysisMesh, testPts, testVec, port, sunlightHoursResult, sunlightHoursMesh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; plug-in component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
shapein = ShapeInBrep(Brep=extr_4, Shape=crv_2)
shadowrange = Ladybug_ShadowStudy(geometry=[item_2, srf], sunVector=sunpath.sunVectors)  # -> readMe, shadow, shade; plug-in component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
crv_3 = Curve(trim.Inside)
shatter = Shatter(Curve=crv_2, Parameters=flatten(ccx.ParamsB))
item_3 = ListItem(List=trim.Outside, Index=0, Wrap=True)
equals = Equality(FirstNumber=shapein, SecondNumber="1")  # -> Equality, Inequality
panel_8 = Panel(shadowrange.readMe)
cull_3 = CullPattern(CullPattern=equals.Equality)
faceb = FaceBoundaries(Mesh=shadowrange.shadow)
colmm = CollisionManyMany(Colliders=flatten([runion, crv_2]))  # -> Collision, Indices
cull_4 = CullPattern(List=shatter, CullPattern=[False, True])
cull_5 = CullPattern(List=shatter, CullPattern=[True, False])
faceb_2 = FaceBoundaries(Mesh=sunlighthoursanalysis.analysisMesh)
len = Length(Curve=cull_4)
panel_9 = Panel(shadowrange.shade)
len_2 = Length(Curve=cull_5)
incurves = PointInCurves()  # -> Relationship, Index, Point
item_4 = ListItem(List=shatter, Index=Slider(0, range=0..10), Wrap=True)
colom = CollisionOneMany(Collider=crv_2, Obstacles=runion)  # -> Collision, Index
item_5 = ListItem(List=runion, Index=colmm.Indices, Wrap=True)
len_3 = Length(Curve=crv_2)
ma_3 = MassAddition(Input=len)  # -> Result, PartialResults
ma_4 = MassAddition(Input=len_2)  # -> Result, PartialResults
cull_6 = CullPattern(List=runion, CullPattern=colmm.Collision)
division = Division(A=ma_3.Result, B=len_3)
division_2 = Division(A=ma_4.Result, B=len_3)
panel_10 = Panel(division)
panel_11 = Panel(division_2)
