# Grasshopper definition Getting OSM Data_2.gh (Grasshopper 1.0.7)
# plug-ins: Human, ElkGHComponents

path = FilePath("C:\Users\jwheeler\Documents\GitHub\aechackathon2019\Grasshopper\Testing Elk\map (1).osm")
path_2 = FilePath("C:\Users\jwheeler\Documents\GitHub\aechackathon2019\Grasshopper\Testing Elk\map.osm")
loc = Location(FilePathText=path)  # -> OSMPointData, OSMFile, LongitudeDomain, LatitudeDomain
topo = Topography()  # -> FileInfo, Points, Curves, Surface
osm = OSMData(
    OSMPointData=loc.OSMPointData,
    OSMFilePath=loc.OSMFile,
    Feature="highway",
    Generate3d=False,
    IndividualOutputs=False,
    SelectedTypes="footway")  # -> Ways, FeatureKey

# ----
# Water
osm_2 = OSMData(
    OSMPointData=loc.OSMPointData,
    OSMFilePath=loc.OSMFile,
    Feature="natural",
    Generate3d=False,
    IndividualOutputs=False,
    SelectedTypes="water")  # -> Ways, FeatureKey
tmatch = MatchText(Text=osm_2.FeatureKey, RegEx="water", Case=True)
ma = MassAddition(Input=tmatch)  # -> Result, PartialResults
cull = CullPattern(List=osm_2.Ways, CullPattern=ma.Result)

# ----
# Grass
osm_3 = OSMData(
    OSMPointData=loc.OSMPointData,
    OSMFilePath=loc.OSMFile,
    Feature="landuse",
    Generate3d=False,
    IndividualOutputs=False,
    SelectedTypes="grass")  # -> Ways, FeatureKey

# ----
# Tree Radius
# Tree Height
panel = Panel("3000")

# ----
# Trees
osm_4 = OSMData(
    OSMPointData=loc.OSMPointData,
    OSMFilePath=loc.OSMFile,
    Feature="natural",
    Generate3d=False,
    IndividualOutputs=False,
    SelectedTypes=["tree", "tree_row"])  # -> Ways, FeatureKey
Z = UnitZ(Factor=panel)
cir = Circle(Plane=osm_4.Ways, Radius="3000")
extr = Extrude(Base=cir, Direction=Z)

panel_2 = Panel(osm.FeatureKey)

# ----
# Bake
pline = PolyLine(Vertices=osm_3.Ways, Closed=False)

# ----
# Bake
pline_2 = PolyLine(Vertices=cull, Closed=False)

# ----
# Bake
cap = CapHoles(Brep=extr)

boundary = BoundarySurfaces(Edges=pline)

# ----
# Height Per Level
panel_3 = Panel("3000")

# ----
# Building Height by Level
osm_5 = OSMData(OSMPointData=loc.OSMPointData, OSMFilePath=loc.OSMFile, Feature="building", Generate3d=False, IndividualOutputs=False)  # -> Ways, FeatureKey
tmatch_2 = MatchText(Text=osm_5.FeatureKey, RegEx="levels", Case=True)
pline_3 = PolyLine(Vertices=osm_5.Ways, Closed=True)
path_mapper = PathMapper(pline_3, source="{A;B}", target="{A}")
ma_2 = MassAddition(Input=tmatch_2)  # -> Result, PartialResults
cull_2 = CullPattern(List=osm_5.FeatureKey, CullPattern=tmatch_2)
split = TextSplit(Text=cull_2, Separators=":")  # -> reverse(Result)
item = ListItem(List=split, Index=0, Wrap=True)
multiplication = Multiplication(A=item, B=panel_3)
dispatch = Dispatch(List=path_mapper, DispatchPattern=ma_2.Result)  # -> ListA, ListB
Z_2 = UnitZ(Factor=multiplication)
Z_3 = UnitZ(Factor=panel_3)
extr_2 = Extrude(Base=dispatch.ListA, Direction=Z_2)  # -> simplify(Extrusion)

# ----
# No Level Data
extr_3 = Extrude(Base=dispatch.ListB, Direction=Z_3)  # -> simplify(Extrusion)
crv = Curve(dispatch.ListB)

# ----
# Bake
cap_2 = CapHoles(Brep=[extr_2, extr_3])

group = Group(Objects=[cap_2, cap, pline_2, boundary])
locationfinder = Ladybug_LocationFinder()  # -> readMe, location; plug-in component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
path_3 = FilePath("C:\Users\jwheeler\Documents\GitHub\aechackathon2019\Grasshopper\USA_WA_Seattle-King.County.Intl.AP-Boeing.Field.727935_TMY3\USA_WA_Seattle-King.County.Intl.AP-Boeing.Field.727935_TMY3.epw")
importepw = Ladybug_ImportEpw(epwFile=path_3)  # -> readMe, latitude, location, dryBulbTemperature, dewPointTemperature, relativeHumidity, windSpeed, windDirection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; plug-in component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
item_2 = ListItem(List=flatten(cap_2), Index=0, Wrap=True)
ladybug = Ladybug_Ladybug()  # -> Vviiiiiiiiiizzz; plug-in component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
srf = Surface(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)
area = Area(Geometry=item_2)  # -> Area, Centroid
day = Panel("30")
month = Panel("3")
hour = Panel("14")
mesh = MeshBrep(
    Brep=flatten(cap_2),
    Settings={GridMaxCount=0, GridMinCount=16, JaggedSeams=False, MaxEdgeLength=0, MinEdgeLength=0.0001, MinTolerance=0, Refine=True, RefineAngle=0, RelativeTolerance=0.65, SimplePlanes=True, Tolerance=0})
panel_4 = Panel(importepw.location)
panel_5 = Panel(ladybug)
sunpath = Ladybug_SunPath(
    location=importepw.location,
    hour=hour,
    day=day,
    month=month,
    timeStep=1,
    centerPt=area.Centroid,
    dailyOrAnnualSunPath=True)  # -> readMe, sunVectors, sunAltitudes, sunAzimuths, port, sunSpheresMesh, sunPathCrvs, compassCrvs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; plug-in component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
mshadow = MeshShadow(Mesh=mesh, Light=sunpath.sunVectors, Plane=PlaneXY(0, 0, 0))
runion = RegionUnion(Curves=flatten(mshadow))
crv_2 = Curve(<curve referenced from the Rhino model>)
boundary_2 = BoundarySurfaces(Edges=runion)
preview = CustomPreview(Geometry=boundary_2, Material=ColourSwatch(SwatchColor=RGB(145, 125, 125)))
colom = CollisionOneMany(Collider=crv_2, Obstacles=graft(runion))  # -> Collision, Index
equals = Equality(FirstNumber=colom.Index, SecondNumber="0")  # -> Equality, Inequality
cull_3 = CullPattern(List=runion, CullPattern=flatten(equals.Equality))
trim = TrimWithRegions(Curve=crv_2, Regions=cull_3)  # -> Inside, Outside
crv_3 = Curve(trim.Outside)
crv_4 = Curve(trim.Inside)
len = Length(Curve=trim.Inside)
len_2 = Length(Curve=trim.Outside)
previewlw = CustomPreviewLineweights(
    Geometry=trim.Inside,
    Shader=ColourSwatch(SwatchColor=RGB(242, 19, 19)),
    Thickness=Slider(5, range=0..10),
    Absolute=False)
len_3 = Length(Curve=crv_2)
ma_3 = MassAddition(Input=len)  # -> Result, PartialResults
ma_4 = MassAddition(Input=len_2)  # -> Result, PartialResults
division = Division(A=ma_3.Result, B=len_3)
division_2 = Division(A=ma_4.Result, B=len_3)
inside = Panel(division)
outside = Panel(division_2)
previewlw_2 = CustomPreviewLineweights(
    Geometry=trim.Outside,
    Shader=ColourSwatch(SwatchColor=RGB(19, 27, 242)),
    Thickness=Slider(5, range=0..10),
    Absolute=False)
